# Dynamo graph paramentros_limites_do_terrero_-_mod_01.dyn (Dynamo 3.5.2.8914)
# packages: Clockwork for Dynamo 3.x 3.3.0

# group: ALINHAMENTO PREDIAL - INPUT
alinhamento_predial = DoubleSlider(1000, range=1..10000 step 100)

# group: ALINHAMENTO PREDIAL - PONTOS DO PERIMETRO
# Descrição <Clique duas vezes aqui para editar a descrição do grupo>
EIXO_ALINHAMENTO_PREDIAL = CodeBlock(alinhamentopredial=alinhamento_predial) { 0; alinhamentopredial; }
byCoordinates = Point.ByCoordinates(x=EIXO_ALINHAMENTO_PREDIAL.out0)
byCoordinates_2 = Point.ByCoordinates(x=EIXO_ALINHAMENTO_PREDIAL.alinhamentopredial)
byStartPointEndPoint = Line.ByStartPointEndPoint(startPoint=byCoordinates, endPoint=byCoordinates_2)

# group: DIVISA LATERAL ESQUERDA - INPUT > ÂNGULO REFERENTE AO EIXO DE ROTAÇÃO DA LATERAL ESQUERDA
number_slider = DoubleSlider(90, range=0..360 step 0.1)

# group: VETOR DE DIREÇÃO DO LIMITE LATERAL ESQUERDO
ALINHAMENTO_PREDIAL = CodeBlock(alinhamentopredial=alinhamento_predial) { 0; alinhamentopredial; }
byCoordinates_3 = Point.ByCoordinates(x=ALINHAMENTO_PREDIAL.out0)
byCoordinates_4 = Point.ByCoordinates(x=ALINHAMENTO_PREDIAL.alinhamentopredial)
ZAxis = Vector.ZAxis()
rotate = Geometry.Rotate(geometry=byCoordinates_4, origin=byCoordinates_3, axis=ZAxis, degrees=number_slider)
byTwoPoints = Vector.ByTwoPoints(start=byCoordinates_3, end=rotate)
normalized = Vector.Normalized(vector=byTwoPoints)

# group: DIVISA LATERAL ESQUERDA - INPUT
divisa_lateral_esquerda = DoubleSlider(2000, range=1..10000 step 100)

# group: LIMITE LATERAL ESQUERDO
byCoordinates_5 = Point.ByCoordinates()
translate = Geometry.Translate(geometry=byCoordinates_5, direction=normalized, distance=divisa_lateral_esquerda)

# group: DIVISA FUNDOS - INPUT > ÂNGULO REFERENTE AO EIXO DE ROTAÇÃO DA DIVISA FUNDOS
number_slider_2 = DoubleSlider(90, range=0..360 step 0.1)

# group: VETOR DE DIREÇÃO DO LIMITE FUNDOS
ZAxis_2 = Vector.ZAxis()
rotate_2 = Geometry.Rotate(geometry=byCoordinates_5, origin=translate, axis=ZAxis_2, degrees=number_slider_2)
byTwoPoints_2 = Vector.ByTwoPoints(start=translate, end=rotate_2)
normalized_2 = Vector.Normalized(vector=byTwoPoints_2)

# group: DIVISA FUNDOS - INPUT
divisa_fundos = DoubleSlider(1000, range=1..10000 step 100)

# group: LIMITE LATERAL ESQUERDO
translate_2 = Geometry.Translate(geometry=translate, direction=normalized_2, distance=divisa_fundos)

# group: DIVISA LATERAL DIREITA - INPUT > ÂNGULO REFERENTE AO EIXO DE ROTAÇÃO DA DIVISA LATERAL DIREITA
number_slider_3 = DoubleSlider(90, range=0..360 step 0.1)

# group: VETOR DE DIREÇÃO DO LIMITE LATERAL DIREITO
ZAxis_3 = Vector.ZAxis()
rotate_3 = Geometry.Rotate(geometry=translate, origin=translate_2, axis=ZAxis_3, degrees=number_slider_3)
byTwoPoints_3 = Vector.ByTwoPoints(start=translate_2, end=rotate_3)
normalized_3 = Vector.Normalized(vector=byTwoPoints_3)

# group: DIVISA LATERAL DIREITA - INPUT
divisa_lateral_direita = DoubleSlider(2000, range=1..10000 step 100)

# group: LIMITE LATERAL DIREITO
translate_3 = Geometry.Translate(geometry=translate_2, direction=normalized_3, distance=divisa_lateral_direita)

# group: ALINHAMENTO PREDIAL - LINHA PARA EIXO
EIXO_DIVISA_LATERAL_ESQUERDA = CodeBlock(divisadireita=divisa_lateral_direita) { -100; divisadireita+100; }
translate_4 = Geometry.Translate(geometry=translate_2, direction=normalized_3, distance=EIXO_DIVISA_LATERAL_ESQUERDA.out1)
translate_5 = Geometry.Translate(geometry=translate_2, direction=normalized_3, distance=EIXO_DIVISA_LATERAL_ESQUERDA.out0)
byStartPointEndPoint_2 = Line.ByStartPointEndPoint(startPoint=translate_4, endPoint=translate_5)

# group: EIXO DIVISA LATERAL ESQUERDA
# Descrição <Clique duas vezes aqui para editar a descrição do grupo>
byLine = Grid.ByLine(line=byStartPointEndPoint_2)
code_block = CodeBlock { "Nome"; }
string = StringInput("DIVISA LATERAL DIREITA")
setParameterByName = Element.SetParameterByName(element=byLine, parameterName=code_block, value=string)

# group: MODIFICA FAMILIA DOS EIXOS
string_2 = StringInput("OC_TERRENO - Limite")
byName = ElementType.ByName(name=string_2)
setType = Custom[Element.SetType](element=setParameterByName, elementType=byName)  # package Clockwork for Dynamo 3.x; Changes the type of a given element to the specified type

# group: ALINHAMENTO PREDIAL - LINHA PARA EIXO
EIXO_DIVISA_LATERAL_ESQUERDA_2 = CodeBlock(divisaesquerda=divisa_lateral_esquerda) { -100; divisaesquerda+100; }
translate_6 = Geometry.Translate(geometry=byCoordinates_5, direction=normalized, distance=EIXO_DIVISA_LATERAL_ESQUERDA_2.out0)
translate_7 = Geometry.Translate(geometry=byCoordinates_5, direction=normalized, distance=EIXO_DIVISA_LATERAL_ESQUERDA_2.out1)
byStartPointEndPoint_3 = Line.ByStartPointEndPoint(startPoint=translate_6, endPoint=translate_7)

# group: EIXO DIVISA LATERAL ESQUERDA
# Descrição <Clique duas vezes aqui para editar a descrição do grupo>
byLine_2 = Grid.ByLine(line=byStartPointEndPoint_3)
code_block_2 = CodeBlock { "Nome"; }
string_3 = StringInput("DIVISA LATERAL ESQUERDA")
setParameterByName_2 = Element.SetParameterByName(element=byLine_2, parameterName=code_block_2, value=string_3)

# group: MODIFICA FAMILIA DOS EIXOS
string_4 = StringInput("OC_TERRENO - Limite")
byName_2 = ElementType.ByName(name=string_4)
setType_2 = Custom[Element.SetType](element=setParameterByName_2, elementType=byName_2)

# group: ALINHAMENTO PREDIAL - LINHA PARA EIXO
EIXO_DIVISA_LATERAL_ESQUERDA_3 = CodeBlock(divisafundos=divisa_fundos) { -100; divisafundos+100; }
translate_8 = Geometry.Translate(geometry=translate, direction=normalized_2, distance=EIXO_DIVISA_LATERAL_ESQUERDA_3.out1)
translate_9 = Geometry.Translate(geometry=translate, direction=normalized_2, distance=EIXO_DIVISA_LATERAL_ESQUERDA_3.out0)
byStartPointEndPoint_4 = Line.ByStartPointEndPoint(startPoint=translate_8, endPoint=translate_9)

# group: EIXO DIVISA LATERAL ESQUERDA
# Descrição <Clique duas vezes aqui para editar a descrição do grupo>
byLine_3 = Grid.ByLine(line=byStartPointEndPoint_4)
code_block_3 = CodeBlock { "Nome"; }
string_5 = StringInput("DIVISA FUNDOS")
setParameterByName_3 = Element.SetParameterByName(element=byLine_3, parameterName=code_block_3, value=string_5)

# group: MODIFICA FAMILIA DOS EIXOS
string_6 = StringInput("OC_TERRENO - Limite")
byName_3 = ElementType.ByName(name=string_6)
setType_3 = Custom[Element.SetType](element=setParameterByName_3, elementType=byName_3)

# group: ALINHAMENTO PREDIAL - LINHA PARA EIXO
# Descrição <Clique duas vezes aqui para editar a descrição do grupo>
EIXO_ALINHAMENTO_PREDIAL_2 = CodeBlock(alinhamentopredial=alinhamento_predial) { -100; alinhamentopredial+100; }
byCoordinates_6 = Point.ByCoordinates(x=EIXO_ALINHAMENTO_PREDIAL_2.out0)
byCoordinates_7 = Point.ByCoordinates(x=EIXO_ALINHAMENTO_PREDIAL_2.out1)
byStartPointEndPoint_5 = Line.ByStartPointEndPoint(startPoint=byCoordinates_6, endPoint=byCoordinates_7)

# group: EIXO ALINHAMENTO PREDIAL
byLine_4 = Grid.ByLine(line=byStartPointEndPoint_5)
code_block_4 = CodeBlock { "Nome"; }
string_7 = StringInput("ALINHAMENTO PREDIAL")
setParameterByName_4 = Element.SetParameterByName(element=byLine_4, parameterName=code_block_4, value=string_7)

# group: MODIFICA FAMILIA DOS EIXOS
string_8 = StringInput("OC_TERRENO - Limite")
byName_4 = ElementType.ByName(name=string_8)
setType_4 = Custom[Element.SetType](element=setParameterByName_4, elementType=byName_4)
