# Dynamo graph TESTE CONSULTA HTTP.dyn "TESTE REQUEST" (Dynamo 3.5.2.8914)
# packages: DynamoIronPython3 1.5.1

string = StringInput("http://127.0.0.1:8000/inputs")
python_script = Python(IN[0]=string)  # IronPython3; unwired: IN[1]
# ---------- python_script.python (13 lines) ----------
from urllib import request
import json

url = IN[0]
timeout = 10

# abre a URL e lê os dados
with request.urlopen(url, timeout=timeout) as resp:
    data = resp.read().decode("utf-8")  # converte de bytes para string

dados = json.loads(data)

OUT = dados
# ----------------------------------------
watch = Watch(python_script)
string_2 = StringInput("http://127.0.0.1:8000/")
